# Grasshopper definition test01.gh (Grasshopper 1.0.7)

file_path = FilePath("D:\test.py")
read_file = ReadFile(File=file_path, PerLineParse=False)  # -> Content
#   port File: Uri of file to read
# ---------- read_file: VB line parser ----------
    action = GH_LineParserAction.Include
    Return line

    'Parse the line and return some data that represents the line.
    'If the line cannot be parsed, you can return Nothing and
    'assign a different action.
    'The default implementation is to just return the line itself.
    'If you return types that implement IGH_Goo, this component
    'will work substantially faster.
# ---------- end read_file ----------
panel = Panel(read_file)
ghpython_script = GhPythonScript(Code=read_file)  # -> Out, Result, A, B, C, D
panel_2 = Panel(ghpython_script.Result)
panel_3 = Panel(ghpython_script.Out)
interpolate = Interpolate(Degree=3, Periodic=False, KnotStyle=1)  # -> Curve, Length, Domain
panel_4 = Panel("D:\IndepStudy\GH_mcp_server\examples\test_CL_GH.py")  # disabled
ghpython_script_2 = GhPythonScript()  # -> out, circle; disabled
# ---------- ghpython_script_2: Python ----------
import Rhino
import Grasshopper
import GhPython
import json
import os

file_path = "D:/IndepStudy/GH_mcp_server/examples/test02.gh"

try:
    # Check if file exists
    if not os.path.exists(file_path):
        print("error: File not found")
        exit()
        
    # Open the Grasshopper file
    gh_doc = Grasshopper.Kernel.GH_Document()
    gh_doc.LoadDocumentObject(file_path)
    
    # Collect basic information
    info = {{
        "file_name": os.path.basename(file_path),
        "component_count": len(gh_doc.Objects),
        "author": gh_doc.Author or "Unknown",
        "description": gh_doc.Description or "No description",
        "date_created": str(gh_doc.CreationDate),
        "date_modified": str(gh_doc.LastSavedDate)
    }}
    
    # Group components by type
    component_types = {{}}
    python_components = []
    
    for obj in gh_doc.Objects:
        # Get the type of the component
        comp_type = obj.__class__.__name__
        if comp_type not in component_types:
            component_types[comp_type] = 0
        component_types[comp_type] += 1
        
        # Collect information about Python components
        if isinstance(obj, GhPython.Component.PythonComponent):
            python_components.append({{
                "name": obj.NickName or "Unnamed",
                "description": obj.Description or "No description",
                "input_count": len(obj.Params.Input),
                "output_count": len(obj.Params.Output)
            }})
    
    # Add to info
    info["component_types"] = component_types
    info["python_components"] = python_components
    
    # Print as JSON
    print(info)
    print(json.dumps(info))
    
except Exception as e:
    print(e)
# ---------- end ghpython_script_2 ----------
file_path_2 = FilePath(panel_4)  # disabled
read_file_2 = ReadFile(File=file_path_2, PerLineParse=False)  # -> Content; disabled; same code as read_file
panel_5 = Panel(ghpython_script_2.out)  # disabled
panel_6 = Panel(read_file_2)  # disabled
ghpython_script_3 = GhPythonScript(Code=read_file_2)  # -> Out, Circle; disabled
panel_7 = Panel(ghpython_script_3.Circle)  # disabled
panel_8 = Panel(ghpython_script_3.Out)  # disabled
