# Grasshopper definition test03.gh (Grasshopper 1.0.7)
# plug-ins: Robot Components, Pufferfish

# ----
# Tools
length = Slider(100, range=0..100)
width = Slider(200, range=0..1000)
height = Slider(1, range=0..10)
unit_y = UnitY(Factor=1)
center_box = CenterBox(Base=PlaneXY(0, 0, 0), X=expr("x/2", length), Y=expr("x/2", width), Z=expr("x/2", height))
number_slider = Slider(261, range=0..1000)
rotate_3d = Rotate3D(Geometry=center_box, Angle=degrees(Slider(30, range=0..100)), Center=Point(0, 0, 0), Axis=unit_y)  # -> Geometry, Transform
unit_z = UnitZ(Factor=number_slider)
addition = Addition(A=Slider(20, range=0..100), B=number_slider)
xy_plane = XYPlane(Origin=Point(0, 0, 0))
move = Move(Geometry=rotate_3d.Geometry, Motion=unit_z)  # -> Geometry, Transform
deconstruct_brep = DeconstructBrep(Brep=move.Geometry)  # -> Faces, Edges, Vertices
transform = Transform(Geometry=xy_plane, Transform=rotate_3d.Transform)
cylinder = Cylinder(Base=PlaneXY(0, 0, 0), Radius=Slider(10, range=0..100), Length=addition)
list_item = ListItem(List=deconstruct_brep.Edges, Index=Slider(7, range=0..10), Wrap=True)
cap_holes = CapHoles(Brep=cylinder)
solid_difference = SolidDifference(BrepsA=cap_holes, BrepsB=move.Geometry)
curve_middle = CurveMiddle(Curve=list_item)
list_item_2 = ListItem(List=solid_difference, Index=0, Wrap=True)  # -> Item, Item1
move_to_point = MoveToPoint(Geometry=transform, PointA=transform, PointB=curve_middle)  # -> Moved, Vector, Transform
merge = Merge(Data1=list_item_2.Item1, Data2=move.Geometry)
solid_union = SolidUnion(Breps=merge)
mesh_brep = MeshBrep(
    Brep=solid_union,
    Settings={GridMaxCount=0, GridMinCount=16, JaggedSeams=False, MaxEdgeLength=0, MinEdgeLength=0.0001, MinTolerance=0, Refine=True, RefineAngle=0, RelativeTolerance=0.65, SimplePlanes=True, Tolerance=0})
robot_tool = RobotTool(Name="tool1", Mesh=mesh_brep, AttachmentPlane=PlaneXY(0, 0, 0), ToolPlane=move_to_point.Moved)

ghpython_script = GhPythonScript()  # -> out, a
# ---------- ghpython_script: Python ----------
__author__ = "veoer"
__version__ = "2025.04.03"

import Rhino.Geometry as rg
import ghpythonlib.components as ghcomp
import math

# Parameters
count = 10          # Number of circles
min_radius = 5.0    # Radius of the smallest circle
max_radius = 50.0   # Radius of the largest circle
spacing = 15.0      # Spacing between circle centers

# Lists to store our results
circles = []
center_points = []

# Calculate radius increment
radius_step = (max_radius - min_radius) / (count - 1)

# Create circles from small to big
for i in range(count):
    # Calculate current radius
    current_radius = min_radius + (radius_step * i)
    
    # Calculate current position (arranged in a line along X-axis)
    current_x = i * spacing
    center = rg.Point3d(current_x, 0, 0)
    
    # Create circle using ghcomp
    circle = ghcomp.Circle(rg.Plane(center, rg.Vector3d.ZAxis), current_radius)
    
    # Add to our lists
    circles.append(circle)
    center_points.append(center)

# Output
a = circles        # Output the circles
b = center_points  # Output the center points (optional)
# ---------- end ghpython_script ----------
addition_2 = Addition()
ghpython_script_2 = GhPythonScript()  # -> out, a
# ---------- ghpython_script_2: Python ----------
__author__ = "veoer"
__version__ = "2025.04.03"

import rhinoscriptsyntax as rs
import Rhino.Geometry as rg

# Create a circle with 50mm radius at the origin
center = rg.Point3d(0, 0, 0)
circle = rg.Circle(rg.Plane.WorldXY, center, 50)

# Output the circle to Grasshopper
a = circle
# ---------- end ghpython_script_2 ----------
ghpython_script_3 = GhPythonScript()  # -> out, a
# ---------- ghpython_script_3: Python ----------
__author__ = "veoer"
__version__ = "2025.04.03"

import rhinoscriptsyntax as rs
import Rhino
import Grasshopper
from Grasshopper.Kernel import GH_ComponentServer

# Access the current Grasshopper document
gh_doc = Grasshopper.Instances.ActiveCanvas.Document

# Find the component by name and type
server = GH_ComponentServer.FindServer(component_name, component_type)
if server is None:
    raise ValueError(f"Component '{component_name}' of type '{component_type}' not found")

# Create the component instance
component = server.Create()
component.ComponentGuid = System.Guid(component_id)

# Set parameters
for param_name, param_value in parameters.items():
    if hasattr(component, param_name):
        setattr(component, param_name, param_value)

# Add the component to the document
gh_doc.AddObject(component, False)

# Set the position on canvas
component.Attributes.Pivot = Grasshopper.Kernel.GH_Convert.ToPoint(
    Rhino.Geometry.Point2d(gh_doc.Bounds.Center.X, gh_doc.Bounds.Center.Y)
)

# Update the document
gh_doc.NewSolution(True)

# Return component info
result = {
    "component_id": str(component_id)
}
"""
# ---------- end ghpython_script_3 ----------
ghpython_script_4 = GhPythonScript(mesh=mesh_brep, plane=move_to_point.Moved)  # -> out, a; inputs mesh: Mesh, plane: Plane
# ---------- ghpython_script_4: Python ----------
__author__ = "veoer"
__version__ = "2025.04.04"

import rhinoscriptsyntax as rs
import Rhino.Geometry as rg
import ghpythonlib.components as ghcomp

att_plane = ghcomp.XYPlane(ghcomp.ConstructPoint(0,0,0))
tool01 = ghcomp.RobotComponents.RobotTool(name="1", mesh=mesh, attachment_plane=att_plane, tool_plane=plane)
robot01 = ghcomp.RobotComponents.RobotPreset(att_plane, tool01)

a=robot01
# ---------- end ghpython_script_4 ----------
robot = Robot(ghpython_script_4.a)
panel = Panel(robot)

# ----
# Robots
robot_preset = RobotPreset(PositionPlane=PlaneXY(0, 0, 0), RobotTool=robot_tool, Robot_Preset_Number=21)

panel_2 = Panel(robot_preset)
robot_2 = Robot(Name="New Robot")
path_generator = PathGenerator(
    Robot=robot_preset,
    Interpolations=5,
    AnimationSlider=Slider(0.647, range=0..1),
    Update=True,
    Output_Configuration_Data=False,
    Output_Configuration_Datas=False,
    Output_Error_Messages=False,
    Output_External_Axis_Planes=False,
    Output_External_Joint_Position=False,
    Output_External_Joint_Positions=False,
    Output_Movement=True,
    Output_Movements=False,
    Output_Path=True,
    Output_Posed_Meshes=False,
    Output_Program_Time=False,
    Output_Robot_End_Plane=True,
    Output_Robot_End_Planes=False,
    Output_Robot_Joint_Position=False,
    Output_Robot_Joint_Positions=True,
    Preview_Path=True,
    Preview_Posed_Meshes=True)  # -> Path, Movement, RobotJointPosition, RobotEndPlane
